# Grasshopper definition cluster_github_test_v0.ghx (Grasshopper 0.9.14)

str = String()
str_2 = String(str)
split = StringSplit(String=str_2, Separators="##TESTEDIT##")
dispatch = Dispatch(List=split, DispatchPattern=[True, False])  # -> flatten(ListA), flatten(ListB)
col = Colour(dispatch.ListB)
geo = Geometry(dispatch.ListA)
col_2 = Colour(col)
geo_2 = Geometry(geo)
